# Dynamo graph 02_Create Grid by List Lacing.dyn (Dynamo 1.2.1.3083)

code_block = CodeBlock { 0..25; }
byCoordinates = Point.ByCoordinates(x=code_block, y=code_block@@L1)
byPoints = PolyCurve.ByPoints(points=byCoordinates)
transpose = List.Transpose(byCoordinates)
byPoints_2 = PolyCurve.ByPoints(points=transpose)
create = List.Create(byPoints, byPoints_2)
curves = PolyCurve.Curves(create)
