# Dynamo graph 03_Solve Own Formula.dyn (Dynamo 1.2.1.3083)

# group: pythagorean
A = DoubleInput(5)
pwr = DoubleInput(2)
pow = Math.Pow(number=A, power=pwr)
B = DoubleInput(5)
pow_2 = Math.Pow(number=B, power=pwr)
add = pow + pow_2

sqrt = Math.Sqrt(add)
byCoordinates = Point.ByCoordinates(x=A)
byCoordinates_2 = Point.ByCoordinates(y=B)
byStartPointEndPoint = Line.ByStartPointEndPoint(startPoint=byCoordinates, endPoint=byCoordinates_2)
length = Curve.Length(byStartPointEndPoint)
eq = sqrt == length
