# Dynamo graph 04_Create Circle By Trigonometry.dyn (Dynamo 1.2.1.3083)

code_block = CodeBlock { 3; }
code_block_2 = CodeBlock { 2.5; }
code_block_3 = CodeBlock { 0..360; }
code_block_4 = CodeBlock(h=code_block, r=code_block_2, a=code_block_3) { h+r*Math.Sin(a); }
code_block_5 = CodeBlock(h=code_block, r=code_block_2, a=code_block_3) { h+r*Math.Cos(a); }
code_block_6 = CodeBlock { 0.01; }
number_slider = DoubleSlider(0.105, range=0..100 step 0.1)
code_block_7 = CodeBlock { 0..3600..10; }
code_block_8 = CodeBlock(h=code_block_6, r=number_slider, a=code_block_7) { h+r*Math.Sin(a); }
byCoordinates = Point.ByCoordinates(x=code_block_4, y=code_block_5, z=code_block_8)
