# Dynamo graph 04_Create Form Own Model.dyn (Dynamo 1.2.1.3083)

byCoordinates = Point.ByCoordinates()
number_slider = DoubleSlider(1, range=0..100 step 1)
byCoordinates_2 = Point.ByCoordinates(z=number_slider)
number_slider_2 = DoubleSlider(63, range=0..100 step 1)
byCoordinates_3 = Point.ByCoordinates(x=number_slider_2)
byThreePoints = Arc.ByThreePoints(firstPoint=byCoordinates, secondPoint=byCoordinates_2, thirdPoint=byCoordinates_3)
number_slider_3 = DoubleSlider(64, range=0..100 step 0.1)
pointsAtEqualChordLength = Curve.PointsAtEqualChordLength(byThreePoints, number_slider_3)
number_slider_4 = DoubleSlider(1.3, range=0..10 step 0.1)
byCoordinates_4 = Point.ByCoordinates(y=number_slider_4)
byThreePoints_2 = Arc.ByThreePoints(firstPoint=byCoordinates, secondPoint=byCoordinates_4, thirdPoint=byCoordinates_3)
pointsAtEqualChordLength_2 = Curve.PointsAtEqualChordLength(byThreePoints_2, number_slider_3)
byStartPointEndPoint = Line.ByStartPointEndPoint(startPoint=pointsAtEqualChordLength, endPoint=pointsAtEqualChordLength_2)
byLoft = Surface.ByLoft(byStartPointEndPoint)
number_slider_5 = DoubleSlider(-0.2, range=-10..10 step 0.1)
byCoordinates_5 = Point.ByCoordinates(y=number_slider_5, z=number_slider)
byThreePoints_3 = Arc.ByThreePoints(firstPoint=byCoordinates, secondPoint=byCoordinates_5, thirdPoint=byCoordinates_3)
pointsAtEqualChordLength_3 = Curve.PointsAtEqualChordLength(byThreePoints_3, number_slider_3)
byStartPointEndPoint_2 = Line.ByStartPointEndPoint(startPoint=pointsAtEqualChordLength, endPoint=pointsAtEqualChordLength_3)
byLoft_2 = Surface.ByLoft(byStartPointEndPoint_2)
code_block = CodeBlock { 1; }
pointsAtEqualChordLength_4 = Curve.PointsAtEqualChordLength(byStartPointEndPoint, code_block)
byStartPointEndPoint_3 = Line.ByStartPointEndPoint(startPoint=pointsAtEqualChordLength_4, endPoint=pointsAtEqualChordLength_3)
flatten = Flatten(byStartPointEndPoint_3)
byLoft_3 = Surface.ByLoft(flatten)
