# Dynamo graph 05_Vector and Coordinate system.dyn (Dynamo 1.2.1.3083)

# group: By Coordinate Translate Method
byCoordinates = Point.ByCoordinates()
code_block = CodeBlock { 0; 10; 25; }
byCoordinates_2 = Point.ByCoordinates(x=code_block.out1, y=code_block.out1)
byCoordinates_3 = Point.ByCoordinates(y=code_block.out2)
byThreePoints = Arc.ByThreePoints(firstPoint=byCoordinates, secondPoint=byCoordinates_2, thirdPoint=byCoordinates_3)
code_block_2 = CodeBlock { 2; }
pointsAtChordLengthFromPoint = Curve.PointsAtChordLengthFromPoint(byThreePoints, byCoordinates, code_block_2)
byPoints = PolyCurve.ByPoints(points=pointsAtChordLengthFromPoint)
curves = PolyCurve.Curves(byPoints)
code_block_3 = CodeBlock { 0; }
planeAtParameter = Curve.PlaneAtParameter(curve=curves, param=code_block_3)
toCoordinateSystem = Plane.ToCoordinateSystem(planeAtParameter)
YAxis = Plane.YAxis(planeAtParameter)
code_block_4 = CodeBlock { 2; }
scale = Vector.Scale(vector=YAxis, scale_factor=code_block_4)
XAxis = Plane.XAxis(planeAtParameter)
scale_2 = Vector.Scale(vector=XAxis, scale_factor=code_block_4)
add = Vector.Add(scale, scale_2)
translate = CoordinateSystem.Translate(toCoordinateSystem, add)
origin = CoordinateSystem.Origin(translate)
byPoints_2 = PolyCurve.ByPoints(points=origin)
curves_2 = PolyCurve.Curves(byPoints_2)

# group: By Geometry Translate Method
byCoordinates_4 = Point.ByCoordinates()
code_block_5 = CodeBlock { 0; 10; 25; }
byCoordinates_5 = Point.ByCoordinates(x=code_block_5.out1, y=code_block_5.out1)
byCoordinates_6 = Point.ByCoordinates(y=code_block_5.out2)
byThreePoints_2 = Arc.ByThreePoints(firstPoint=byCoordinates_4, secondPoint=byCoordinates_5, thirdPoint=byCoordinates_6)
code_block_6 = CodeBlock { 2; }
pointsAtChordLengthFromPoint_2 = Curve.PointsAtChordLengthFromPoint(byThreePoints_2, byCoordinates_4, code_block_6)
byPoints_3 = PolyCurve.ByPoints(points=pointsAtChordLengthFromPoint_2)
curves_3 = PolyCurve.Curves(byPoints_3)
code_block_7 = CodeBlock { 0; }
planeAtParameter_2 = Curve.PlaneAtParameter(curve=curves_3, param=code_block_7)
YAxis_2 = Plane.YAxis(planeAtParameter_2)
code_block_8 = CodeBlock { 2; }
scale_3 = Vector.Scale(vector=YAxis_2, scale_factor=code_block_8)
XAxis_2 = Plane.XAxis(planeAtParameter_2)
scale_4 = Vector.Scale(vector=XAxis_2, scale_factor=code_block_8)
add_2 = Vector.Add(scale_3, scale_4)
translate_2 = Geometry.Translate(geometry=pointsAtChordLengthFromPoint_2, direction=add_2)
byPoints_4 = PolyCurve.ByPoints(points=translate_2)
curves_4 = PolyCurve.Curves(byPoints_4)
