# Dynamo graph 06_Filter Search  Object from List.dyn (Dynamo 1.2.1.3083)

code_block = CodeBlock { "Hello"; "World"; "Revit"; "Dynamo"; "Python"; }
create = List.Create(code_block.out0, code_block.out1, code_block.out2, code_block.out3, code_block.out4)
code_block_2 = CodeBlock { "Revit"; }
containsItem = List.ContainsItem(list=create@@L1, item=code_block_2)
filterByBoolMask = List.FilterByBoolMask(list=create, mask=containsItem)
watch = Watch(filterByBoolMask.in)
