# Dynamo graph 07_Create model line from dynamo.dyn (Dynamo 1.2.1.3083)

code_block = CodeBlock { 10..50..10; }
byCoordinates = Point.ByCoordinates(x=code_block@L1, y=code_block)
byCoordinates_2 = Point.ByCoordinates(y=code_block@@L1, z=code_block)
byStartPointEndPoint = Line.ByStartPointEndPoint(startPoint=byCoordinates, endPoint=byCoordinates_2)
byCurve = ModelCurve.ByCurve(byStartPointEndPoint)
