# Dynamo graph 08_Nested List, Flatten and Chop Difference.dyn (Dynamo 1.2.1.3083)

# group: List to Flatten to Chop
code_block = CodeBlock { "A".."Z"; }
code_block_2 = CodeBlock { "Z".."A"; }
create = List.Create(code_block, code_block_2)
flatten = Flatten(create)
code_block_3 = CodeBlock { 1; }
chop = List.Chop(list=flatten, lengths=code_block_3)
code_block_4 = CodeBlock { 2; }
chop_2 = List.Chop(list=flatten, lengths=code_block_4)

# group: Chop Lacing
code_block_5 = CodeBlock { "A".."Z"; }
code_block_6 = CodeBlock { "Z".."A"; }
create_2 = List.Create(code_block_5, code_block_6)
code_block_7 = CodeBlock { 2; }
chop_3 = List.Chop(list=create_2@L2, lengths=code_block_7)

# group: Nested List
code_block_8 = CodeBlock { "A".."Z"; }
code_block_9 = CodeBlock { "Z".."A"; }
create_3 = List.Create(code_block_8, code_block_9)
code_block_10 = CodeBlock { 2; }
chop_4 = List.Chop(list=create_3@L9, lengths=code_block_10@@L9)

# group: List to Chop to Flatten
code_block_11 = CodeBlock { "A".."Z"; }
code_block_12 = CodeBlock { "Z".."A"; }
create_4 = List.Create(code_block_11, code_block_12)
code_block_13 = CodeBlock { 1; }
chop_5 = List.Chop(list=create_4, lengths=code_block_13)
flatten_2 = Flatten(chop_5@L3)
