# Dynamo graph 09_Create Solid By Geometry.dyn (Dynamo 1.2.1.3083)

number = DoubleInput(1)
number_2 = DoubleInput(25)
number_3 = DoubleInput(1)
range = Range(start=number, end=number_2, step=number_3, lacing=Longest)
byCoordinates = Point.ByCoordinates(x=range, y=range@L1)
byPoints = PolyCurve.ByPoints(points=byCoordinates)
byLoft = Surface.ByLoft(byPoints)
code_block = CodeBlock { 10; }
boolean = BoolSelector(false)
thicken = Surface.Thicken(surface=byLoft, thickness=code_block, both_sides=boolean)
bySolid = PolySurface.BySolid(thicken)
surfaces = PolySurface.Surfaces(bySolid)
UVParameterAtPoint = Surface.UVParameterAtPoint(surfaces, byCoordinates)
