# Dynamo graph 10_Create grid use Dynamo.dyn (Dynamo 1.2.1.3083)

# group: Option
byArc = Grid.ByArc()  # unwired: arg0
byStartPointEndPoint = Grid.ByStartPointEndPoint()  # unwired: arg0, arg1

file_path = Filename("..\Training%20Graphs\Test\Grid.xlsx")
fromPath = FileObject(file_path)  # "File.FromPath"
string = StringInput("Sheet1")
boolean = BoolSelector(false)
readFromFile = Excel.ReadFromFile(file=fromPath, sheetName=string, readAsStrings=boolean)
transpose = List.Transpose(readFromFile)
code_block = CodeBlock(l=transpose) { l[0]; l[1]; }
byCoordinates = Point.ByCoordinates(x=code_block.out0, y=code_block.out1@L1, lacing=CrossProduct)
flatten = Flatten(byCoordinates@L2)
byPoints = PolyCurve.ByPoints(points=flatten)
startPoint = Curve.StartPoint(byPoints)
endPoint = Curve.EndPoint(byPoints)
byStartPointEndPoint_2 = Line.ByStartPointEndPoint(startPoint=startPoint, endPoint=endPoint)
transpose_2 = List.Transpose(byCoordinates)
byPoints_2 = PolyCurve.ByPoints(points=transpose_2)
startPoint_2 = Curve.StartPoint(byPoints_2)
endPoint_2 = Curve.EndPoint(byPoints_2)
byStartPointEndPoint_3 = Line.ByStartPointEndPoint(startPoint=startPoint_2, endPoint=endPoint_2)
create = List.Create(byStartPointEndPoint_2, byStartPointEndPoint_3)
byLine = Grid.ByLine(create)
