# Dynamo graph 11_Create level use Dynamo.dyn (Dynamo 1.2.1.3083)

file_path = Filename("..\Training%20Graphs\Test\Level.xlsx")
fromPath = FileObject(file_path)  # "File.FromPath"
code_block = CodeBlock { "Sheet1"; }
boolean = BoolSelector(false)
readFromFile = Excel.ReadFromFile(file=fromPath, sheetName=code_block, readAsStrings=boolean)
transpose = List.Transpose(readFromFile)
number = DoubleInput(1)
getItemAtIndex = List.GetItemAtIndex(list=transpose, index=number)
number_2 = DoubleInput(1)
chop = List.Chop(list=getItemAtIndex, lengths=number_2)
number_3 = DoubleInput(0)
getItemAtIndex_2 = List.GetItemAtIndex(list=transpose, index=number_3)
chop_2 = List.Chop(list=getItemAtIndex_2, lengths=number_2)
byElevationAndName = Level.ByElevationAndName(chop, chop_2)

# group: Option
byElevation = Level.ByElevation()  # unwired: arg0
byLevelAndOffset = Level.ByLevelAndOffset()  # unwired: arg0, arg1
byLevelOffsetAndName = Level.ByLevelOffsetAndName()  # unwired: arg0, arg1, arg2
