# Dynamo graph 12_Import Excel.dyn (Dynamo 1.2.1.3083)

file_path = Filename("C:\Users\Z440\Desktop\dynamo\Exersice Programs\train.xlsx")
fromPath = FileObject(file_path)  # "File.FromPath"
code_block = CodeBlock { "Ex-1"; }
boolean = BoolSelector(false)
readFromFile = Excel.ReadFromFile(file=fromPath, sheetName=code_block, readAsStrings=boolean)
