# Dynamo graph 13_Export Excel.dyn (Dynamo 1.2.1.3083)

code_block = CodeBlock { "Sheet1"; }
code_block_2 = CodeBlock { 0; }
code_block_3 = CodeBlock { 0; }
code_block_4 = CodeBlock { 0..25..1; }
byCoordinates = Point.ByCoordinates(x=code_block_4, y=code_block_4@@L1)
X = Point.X(byCoordinates)
Y = Point.Y(byCoordinates)
Z = Point.Z(byCoordinates)
create = List.Create(X, Y, Z)
transpose = List.Transpose(create)
boolean = BoolSelector(true)
writeToFile = Excel.WriteToFile(sheetName=code_block, startRow=code_block_2, startCol=code_block_3, data=transpose, overWrite=boolean)  # unwired: filePath
