# Dynamo graph 14_Create Element from mass.dyn (Dynamo 1.2.1.3083)

family_types = FamilyTypes("Mass 1:Mass 1")
family_types_2 = FamilyTypes("Mass 2:Mass 2")
family_types_3 = FamilyTypes("Mass 3:Mass 3")
create = List.Create(family_types, family_types_2, family_types_3)
all_elements_of_family_type = ElementsOfFamilyType(create)
type = archilab.Revit.Elements.Elements.Type(all_elements_of_family_type)
flatten = Flatten(type)
geometry = Element.Geometry(flatten)
flatten_2 = Flatten(geometry)
categories = Categories("Floors")
code_block = CodeBlock { "Screeding Floor"; "Left Platform"; "Right Platform"; }
create_2 = List.Create(code_block.out0, code_block.out1, code_block.out2)
byGeometry = Custom[Springs.DirectShape.ByGeometry](geometry=flatten_2, category=categories, name=create_2)  # Convert the input geometry to DirectShape element inside the Revit document. It supports solids or surfaces. It is based on an alternative process that uses a SAT import and can produce smooth surfaces. Each created DS will have a unique type. Make sure that each input geometry has a unique name. You can either feed a single category for all geometries or a unique category for each geometry - the node's lacing is set to longest by default. The default category is Generic Models.

# group: Option
code_block_2 = CodeBlock { "Structure, Timber Joist/Rafter Layer"; }
byName = Material.ByName(code_block_2)
byGeometry_2 = Custom[Springs.BrepShape.ByGeometry](material=byName)  # Convert the input geometry to DirectShape element inside the Revit document. Works only in Revit 2017 and later. Usies the more advanced BrepBuilder. It supports solids or surfaces, however periodic faces like spheres, cylinders and cones are not supported. Each created DS will have a unique type. Make sure that each input geometry has a unique name. You can either feed a single category and material for all geometries or a unique one for each geometry - the node's lacing is set to longest by default. The default category is Generic Model.; unwired: geometry, name
