# Dynamo graph 15_Create Topography to Floor.dyn (Dynamo 1.2.1.3083)

# group: Select topography
select_model_element = DSModelElementSelection()

code_block = CodeBlock(select_model_element) { Topo : Topography; }
mesh = Topography.Mesh(code_block)
vertexPositions = Mesh.VertexPositions(mesh)
faceIndices = Mesh.FaceIndices(mesh)
A = IndexGroup.A(faceIndices)
B = IndexGroup.B(faceIndices)
C = IndexGroup.C(faceIndices)
create = List.Create(A, B, C)
transpose = List.Transpose(create)
getItemAtIndex = List.GetItemAtIndex(list=vertexPositions, index=transpose)
byPerimeterPoints = Surface.ByPerimeterPoints(getItemAtIndex)
byJoinedSurfaces = PolySurface.ByJoinedSurfaces(byPerimeterPoints)
surfaces = PolySurface.Surfaces(byJoinedSurfaces)

# group: thickness
code_block_2 = CodeBlock { 0.15; }

boolean = BoolSelector(false)
thicken = Surface.Thicken(surface=surfaces, thickness=code_block_2, both_sides=boolean)
categories = Categories("Floors")

# group: Floor Material
string = StringInput("Default")

byName = Material.ByName(string)
count = Count(surfaces)
code_block_3 = CodeBlock(X=count) { "A"..#X..1; }
code_block_4 = CodeBlock(STR_1=code_block_3, STR_2=code_block_3) { STR_4=STR_1<1>+STR_2<2>; }
code_block_5 = CodeBlock(B=code_block_4) { "Floor"+B; }
flatten = Flatten(code_block_5)
code_block_6 = CodeBlock { 0; }
code_block_7 = CodeBlock { 1; }
slice = List.Slice(flatten, code_block_6, count, code_block_7)
byGeometry = DirectShape.ByGeometry(geometry=thicken, category=categories, material=byName, name=slice)
