# Dynamo graph 16_Family Place by Distance.dyn (Dynamo 1.2.1.3083)

# group: Select Family
family_types = FamilyTypes("light:light")

byCoordinates = Point.ByCoordinates()
code_block = CodeBlock { 0; 10; 15; }
byCoordinates_2 = Point.ByCoordinates(x=code_block.out1, y=code_block.out1)
byCoordinates_3 = Point.ByCoordinates(x=code_block.out2, y=code_block.out1)
byThreePoints = Arc.ByThreePoints(firstPoint=byCoordinates, secondPoint=byCoordinates_2, thirdPoint=byCoordinates_3)
code_block_2 = CodeBlock { 10; }
pointsAtEqualChordLength = Curve.PointsAtEqualChordLength(byThreePoints, code_block_2)
byPoint = FamilyInstance.ByPoint(familyType=family_types, point=pointsAtEqualChordLength)
byPoints = PolyCurve.ByPoints(points=pointsAtEqualChordLength)
curves = PolyCurve.Curves(byPoints)
tangentAtParameter = Curve.TangentAtParameter(curves)
flatten = Flatten(tangentAtParameter)

# group: Zhukoven.com package
getRotation = Custom[Element.GetRotation](InputVector=tangentAtParameter, Rotate90=flatten)  # This node calculates rotation angle between selected element's vector and Y axis. Vector Z is used as rotation axis. Use resulting degree as an input to the FamilyInstance.SetRotation node.

setRotation = FamilyInstance.SetRotation(familyInstance=byPoint, degree=getRotation)
