# Dynamo graph 17_Family Model and Project model.dyn (Dynamo 1.2.1.3083)

select_model_element = DSModelElementSelection()  # 1 picked in the model
# note: Springs Node
geometry = Element.Geometry(select_model_element)
file_path = Filename("C:\ProgramData\Autodesk\RVT 2015\Family Templates\English\Metric Electrical Fixture.rft")
string = StringInput("light")
categories = Categories("LightingFixtures")
code_block = CodeBlock { "Default"; }
byName = Material.ByName(code_block)
boolean = BoolSelector(false)
byGeometry = Custom[Springs.FamilyInstance.ByGeometry](geometry=geometry, familyTemplatePath=file_path, familyName=string, category=categories, materialName=byName, isVoid=boolean)  # You must provide a valid family template path that will be used for all input geometry objects. The project units(and not the templates) will be used to determine the size of the output geometry. The provided category will be used only if the family template supports it. If not, the default template category will be used instead. Likewise, the family material(provided as a string) will be set only if a material with that name exists in the template. If not, the default material will be used instead ("By Category"). For void cuts, the material settings will be ignored. The Subcategory name is an optional input. If you'd like to skip assigning a Subcategory to any new instance, simply use null. The node expects a unique family name for each geometry object. The rest of the input lists will be processed as if the node lacing is set to longest.
categories_2 = Categories("ElectricalFixtures")
byGeometry_2 = DirectShape.ByGeometry(geometry=geometry, category=categories_2, material=byName, name=string)
