# Dynamo graph 18_Copy Element From Linked Model.dyn (Dynamo 1.2.1.3083)

documet_get_linked_model_with = Custom[Documet.Get Linked Model (with Instance and Doc)]()  # Obtenir les fichiers de maquettes Revit et IFC liés au document courant. (from Archi-Lab Grimshaw)
categories = Categories("MEPSpaces")
linkedInstanceElements = Custom[Springs.Collector.LinkedInstanceElements](linkInstance=documet_get_linked_model_with.Link_Instance, category=categories)  # Extract elements by category from the selected linked instances. The transform CS can be used to get the exact location of the elements in the host file. If an error occurs or the linked document is unloaded, an error will be returned in the elements output and the appropriate transform will be a null. You can use those nulls to filter out the errors.
copyFromLinkInstance = Custom[Springs.Doc.CopyFromLinkInstance](LinkInstance=documet_get_linked_model_with.Link_Instance, element=linkedInstanceElements.elements)  # The node will use the total transformation of the link instance to copy the input elements into the local document.
