# Dynamo graph 19_CAD MText Location.dyn (Dynamo 1.2.1.3083)

boolean = BoolSelector(true)
boolean_2 = BoolSelector(true)
# note: Rythm Nodes
pick_model_element = Custom[Pick Model Element](refresh=boolean_2)  # This offers a single selection of a model element. Created for Dynamo Player usage.
layers = Custom[ImportInstance.Layers](ImportInstance=pick_model_element)  # Get layer list of linked or imported DWG
code_block = CodeBlock(l=layers) { l[2]; }
# note: DynamoCAD
import_text_mtext_from_autocad = Custom[Import Text&MText from Autocad](Reset=boolean, Layer=code_block, Layer_ON=boolean, Text_ON=boolean, MText_ON=boolean)  # Import Text&MText from Autocad
transpose = List.Transpose(import_text_mtext_from_autocad)
code_block_2 = CodeBlock(l=transpose) { l[1]; }
transpose_2 = List.Transpose(code_block_2)
x = CodeBlock(l=transpose_2) { l[0]; }
y = CodeBlock(l=transpose_2) { l[1]; }
byCoordinates = Point.ByCoordinates(x=x, y=y)
code_block_3 = CodeBlock(l=layers) { l[1]; }
import_lines = Custom[Import Lines](Reset=boolean, Layer=code_block_3, Layer_ON=boolean)
boolean_3 = BoolSelector(false)
groupGeometriesByLayer = Custom[ImportInstance.GroupGeometriesByLayer](LinkedDWG=pick_model_element, ColorDisplay=boolean_3)  # Group geometries in ImportInstance by their layer name and convert the inside meshes into polysurface
