# Dynamo graph 20_Create  MEP service By line.dyn (Dynamo 1.2.1.3083)

code_block = CodeBlock { 0..20..10; }
byCoordinates = Point.ByCoordinates(x=code_block, y=code_block@@L1)
transpose = List.Transpose(byCoordinates)
byPoints = PolyCurve.ByPoints(points=transpose)
startPoint = Curve.StartPoint(byPoints)
endPoint = Curve.EndPoint(byPoints)
byStartPointEndPoint = Line.ByStartPointEndPoint(startPoint=startPoint, endPoint=endPoint)
code_block_2 = CodeBlock { 1; 2; 0; }
levels = Levels("Level 1")
code_block_3 = CodeBlock { 0.25; }

# group: Pipe System
getItemAtIndex = List.GetItemAtIndex(list=byStartPointEndPoint, index=code_block_2.out0)
nameCollector = Elements.PipeType.NameCollector()
code_block_4 = CodeBlock { 0; }
getItemAtIndex_2 = List.GetItemAtIndex(list=nameCollector, index=code_block_4)
byName = Elements.PipeType.ByName(getItemAtIndex_2)
nameCollector_2 = Elements.PipingSystemType.NameCollector()
getItemAtIndex_3 = List.GetItemAtIndex(list=nameCollector_2, index=code_block_4)
byName_2 = Elements.PipingSystemType.ByName(getItemAtIndex_3)
byLines = Custom[Pipe.ByLines](Lines=getItemAtIndex, PipeType=byName, SystemType=byName_2, Level=levels, Diameter=code_block_3)  # Creates a pipe by Line, PipeType, SystemType, Level and Diameter

# group: Electrical System
getItemAtIndex_4 = List.GetItemAtIndex(list=byStartPointEndPoint, index=code_block_2.out2)
nameCollector_3 = Elements.ConduitType.NameCollector()
code_block_5 = CodeBlock { 0; }
getItemAtIndex_5 = List.GetItemAtIndex(list=nameCollector_3, index=code_block_5)
byName_3 = Elements.ConduitType.ByName(getItemAtIndex_5)
byLines_2 = Custom[Conduit.ByLines](Lines=getItemAtIndex_4, ConduitType=byName_3, Level=levels, Diameter=code_block_3)  # Creates conduits by Line, ConduitType, Level and Diameter

# group: Duct System
getItemAtIndex_6 = List.GetItemAtIndex(list=byStartPointEndPoint, index=code_block_2.out1)
nameCollector_4 = Elements.DuctType.NameCollector()
code_block_6 = CodeBlock { 0; }
getItemAtIndex_7 = List.GetItemAtIndex(list=nameCollector_4, index=code_block_6)
byName_4 = Elements.DuctType.ByName(getItemAtIndex_7)
nameCollector_5 = Elements.DuctSystemType.NameCollector()
getItemAtIndex_8 = List.GetItemAtIndex(list=nameCollector_5, index=code_block_6)
byName_5 = Elements.DuctSystemType.ByName(getItemAtIndex_8)
code_block_7 = CodeBlock { 0.15; }
byLines_3 = Custom[DuctRectangular.ByLines](Lines=getItemAtIndex_6, DuctType=byName_4, MechanicalSystemType=byName_5, Level=levels, Width=code_block_7, Height=code_block_7)  # Create ducts by Lines, DuctType, MechanicalFittingType, Level, Width and Height
