# Dynamo graph 21_Element in Space and Room.dyn (Dynamo 1.2.1.3083)

categories = Categories("DuctTerminal")
categories_2 = Categories("LightingFixtures")
categories_3 = Categories("PlumbingFixtures")
create = List.Create(categories, categories_2, categories_3)
all_elements_of_category = ElementsOfCategory(create)
flatten = Flatten(all_elements_of_category@L1)

# group: Is Room == true Space == False
boolean = BoolSelector(true)

get_element_s_room = Custom[Get Element's Room](Element_s=flatten@L2)  # This node takes the input of all elements of category and reports back the associated room per element. Currently tested with casework, furniture and plumbing fixtures.
space = Custom[Element.Space](element=flatten@L2)  # This will retrieve the space in which an element is contained. (if available)
if_ = If(test=boolean, true=get_element_s_room, false=space)
code_block = CodeBlock(out=if_) { out; }
isNull = Object.IsNull(code_block@L1)
filterByBoolMask = List.FilterByBoolMask(list=flatten, mask=isNull)

# group: COBie Parameter Name for Element Space( Terminals, Valve, ect.,)
string = StringInput("Comments")

removeNulls = Lists.Manage.RemoveNulls(code_block)

# group: COBie Parameter Name for Space
string_2 = StringInput("Name")

getParameterValueByName = Element.GetParameterValueByName(element=removeNulls, parameterName=string_2)
setParameterByName = Element.SetParameterByName(element=filterByBoolMask.out, parameterName=string, value=getParameterValueByName)
code_block_2 = CodeBlock { "Not in Room"; }
code_block_3 = CodeBlock { "Not in Space"; }
if_2 = If(test=boolean, true=code_block_2, false=code_block_3)
setParameterByName_2 = Element.SetParameterByName(element=filterByBoolMask.in, parameterName=string, value=if_2)
watch = Watch(removeNulls)
