# Dynamo graph 22_Room Or Space Separato From Linked model.dyn (Dynamo 1.2.1.3083)

documet_get_linked_model_with = Custom[Documet.Get Linked Model (with Instance and Doc)]()  # Obtenir les fichiers de maquettes Revit et IFC liés au document courant. (from Archi-Lab Grimshaw)
categories = Categories("Rooms")
linkedInstanceElements = Custom[Springs.Collector.LinkedInstanceElements](linkInstance=documet_get_linked_model_with.Link_Instance, category=categories)  # Extract elements by category from the selected linked instances. The transform CS can be used to get the exact location of the elements in the host file. If an error occurs or the linked document is unloaded, an error will be returned in the elements output and the appropriate transform will be a null. You can use those nulls to filter out the errors.
copyFromLinkInstance = Custom[Springs.Doc.CopyFromLinkInstance](LinkInstance=documet_get_linked_model_with.Link_Instance, element=linkedInstanceElements.elements)  # The node will use the total transformation of the link instance to copy the input elements into the local document.
flatten = Flatten(linkedInstanceElements.elements)
python_script = Python(IN[0]=flatten)
# ---------- python_script.python (51 lines) ----------
import clr
clr.AddReference('RevitAPI')
from Autodesk.Revit.DB import *
import Autodesk

clr.AddReference("RevitNodes")
import Revit
clr.ImportExtensions(Revit.GeometryConversion)

items = UnwrapElement(IN[0])
elementlist = list()
curvelist = list()

for item in items:
	doc = item.Document
	calculator = SpatialElementGeometryCalculator(doc)
	options = Autodesk.Revit.DB.SpatialElementBoundaryOptions()
	# get boundary location from area computation settings
	boundloc = Autodesk.Revit.DB.AreaVolumeSettings.GetAreaVolumeSettings(doc).GetSpatialElementBoundaryLocation(SpatialElementType.Room)
	options.SpatialElementBoundaryLocation = boundloc
	#method #1 - get boundary segments
	#Revit 2017
	blist = list()
	clist = list()
	try:
		for boundarylist in item.GetBoundarySegments(options):
			for boundary in boundarylist:
				blist.append(doc.GetElement(boundary.ElementId))
				clist.append(boundary.GetCurve().ToProtoType())
	except:
		pass
	#method #1 - before Revit 2017	
	try:
		for boundarylist in item.GetBoundarySegments(options):
			for boundary in boundarylist:
				blist.append(boundary.Element)
				clist.append(boundary.Curve.ToProtoType())
	except:
		pass	
	#method #2 - spatial element geometry calculator
	try:
		results = calculator.CalculateSpatialElementGeometry(item)
		for face in results.GetGeometry().Faces:
			for bface in results.GetBoundaryFaceInfo(face):
				blist.append(doc.GetElement(bface.SpatialBoundaryElement.HostElementId))
	except:
		pass	
	# write results to list
	elementlist.append(blist)
	curvelist.append(clist)
OUT = (elementlist,curvelist)
# ----------------------------------------
code_block = CodeBlock(l=python_script) { l[1]; }
fromLine = Custom[Curve.FromLine](line=code_block@L2)  # This will translate a line element to a curve.
flatten_2 = Flatten(fromLine@L3)
flatten_3 = Flatten(linkedInstanceElements.elements)
level = Custom[Element.Level](element=flatten_3)  # Gets an element's level
plane = Custom[Level.Plane](level=level)  # Retrieves the plane of a given level
byPlane = SketchPlane.ByPlane(plane)
views = Views("Level 1")
fromCurve = Custom[SpaceSeparator.FromCurve](curve=flatten_2, sketchPlane=byPlane, view=views)  # Creates space separation lines from geometry curves.
