# Dynamo graph 23_Get and Set Parameter.dyn (Dynamo 1.2.1.3083)

categories = Categories("Doors")
all_elements_of_category = ElementsOfCategory(categories)
code_block = CodeBlock { "AMCS Room Name"; }
rooms = Custom[Door.Rooms](door=all_elements_of_category)  # Gets the rooms that are connected by a given door
code_block_2 = CodeBlock { "Name"; }
getParameterAsValueString = Custom[GetParameterAsValueString](Elements=rooms.fromRoom, ParameterName=code_block_2)  # Returns the parameter values without conversion to the revit internal unit system. The suffix boolean toggles the project units on or off
setParameterByName = Element.SetParameterByName(element=all_elements_of_category, parameterName=code_block, value=getParameterAsValueString)
code_block_3 = CodeBlock { "AMCS Room Number"; }
code_block_4 = CodeBlock { "Number"; }
getParameterAsValueString_2 = Custom[GetParameterAsValueString](Elements=rooms.fromRoom, ParameterName=code_block_4)
setParameterByName_2 = Element.SetParameterByName(element=all_elements_of_category, parameterName=code_block_3, value=getParameterAsValueString_2)
setParameterByName_3 = Element.SetParameterByName(element=rooms.fromRoom, parameterName=code_block_3, value=getParameterAsValueString_2)
setParameterByName_4 = Element.SetParameterByName(element=rooms.fromRoom, parameterName=code_block, value=getParameterAsValueString)
code_block_5 = CodeBlock { "Level"; }
getParameterAsValueString_3 = Custom[GetParameterAsValueString](Elements=rooms.fromRoom, ParameterName=code_block_5@L1)
flatten = Flatten(getParameterAsValueString_3)
duplicateItemIndicies = archilab.Lists.Lists.DuplicateItemIndicies(getParameterAsValueString_3@@L2)
flatten_2 = Flatten(duplicateItemIndicies)
uniqueItems = List.UniqueItems(flatten_2)
getItemAtIndex = List.GetItemAtIndex(list=flatten, index=uniqueItems)
getLevelByName = archilab.Revit.Selection.Select.GetLevelByName(getItemAtIndex)
code_block_6 = CodeBlock { "AMCS Level Code"; }
code_block_7 = CodeBlock { "AMCS Level Code"; }
getParameterValueByName = Element.GetParameterValueByName(element=rooms.fromRoom, parameterName=code_block_7)
getItemAtIndex_2 = List.GetItemAtIndex(list=getParameterValueByName, index=uniqueItems)
setParameterByName_5 = Element.SetParameterByName(element=getLevelByName, parameterName=code_block_6, value=getItemAtIndex_2)
