# Dynamo graph 24_Create Sheet Use Excel.dyn (Dynamo 1.2.1.3083)

file_path = Filename("..\Desktop\dynamo\training\Sheet%20By%20Excel.xlsx")
fromPath = FileObject(file_path)  # "File.FromPath"
string = StringInput("Sheet1")
readFromFile = Excel.ReadFromFile(file=fromPath, sheetName=string)
transpose = List.Transpose(readFromFile)
number = DoubleInput(1)
getItemAtIndex = List.GetItemAtIndex(list=transpose, index=number)
boolean = BoolSelector(false)
clean = List.Clean(list=getItemAtIndex, preserveIndices=boolean)
code_block = CodeBlock { 1; }
chop = List.Chop(list=clean, lengths=code_block)
number_2 = DoubleInput(0)
getItemAtIndex_2 = List.GetItemAtIndex(list=transpose, index=number_2)
clean_2 = List.Clean(list=getItemAtIndex_2, preserveIndices=boolean)
chop_2 = List.Chop(list=clean_2, lengths=code_block)
family_types = FamilyTypes("E1 30 x 42 Horizontal:E1 30x42 Horizontal")
boolean_2 = BoolSelector(true)
views_get_all_views_by_type = Custom[Views.Get All Views by type](FloorPlans=boolean_2, CeilingPlans=boolean_2, Elevations=boolean_2, Sections=boolean_2)  # Obtenir les vues du projet par types (MyBIMtheque)
create = List.Create(views_get_all_views_by_type.FloorPlans, views_get_all_views_by_type.CeilingPlans, views_get_all_views_by_type.Elevations, views_get_all_views_by_type.Sections)
flatten = Flatten(create)
number_3 = DoubleInput(3)
getItemAtIndex_3 = List.GetItemAtIndex(list=transpose, index=number_3)
clean_3 = List.Clean(list=getItemAtIndex_3, preserveIndices=boolean)
removeNulls = Lists.Manage.RemoveNulls(clean_3)
flatten_2 = Flatten(removeNulls)
boolean_3 = BoolSelector(true)
filterByName = Custom[Elements.FilterByName](elements=flatten, searchString=flatten_2, ignoreCase=boolean_3)  # Retrieves those elements from a collection whose names match the search string
flatten_3 = Flatten(filterByName.in)
byNameNumberTitleBlockAndView = Sheet.ByNameNumberTitleBlockAndView(sheetName=chop, sheetNumber=chop_2, titleBlockFamilyType=family_types, view=flatten_3)
