# Dynamo graph 25_Foam.dyn (Dynamo 1.2.1.3083)

# note: Note:
# Form based on conceptual mass
code_block = CodeBlock { 5; }
byCartesianCoordinates = Point.ByCartesianCoordinates(arg3=code_block)
byCenterPointRadius = Circle.ByCenterPointRadius(centerPoint=byCartesianCoordinates)
byCenterPointRadius_2 = Circle.ByCenterPointRadius()
create = List.Create(byCenterPointRadius, byCenterPointRadius_2)
byCurve = ModelCurve.ByCurve(create)
boolean = BoolSelector(true)
byLoftCrossSections = Form.ByLoftCrossSections(byCurve, boolean)
